# Grasshopper definition convert_building_physics.gh (Grasshopper 0.9.76)
# plug-ins: Python Interpreter, FalseStartToggle

# ---- group: Starting date (simulation day)
run_radiation = FalseStartToggle(False)
number_of_hours = Panel("138")
start_day = Panel("1")
start_month = Panel("2")

# ----
# Draw a room with windows
panel = Panel("4.9")
# Get temperatures and calculate radiation using ladybug
outward_facing_surfaces = Panel("0")
ladybug = Ladybug_Ladybug()  # -> Vviiiiiiiiiizzz; plug-in component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
box = DomainBox(Base=PlaneXY(0, 0, 0), X=panel, Y="7", Z="3.1")
debrep = DeconstructBrep(Brep=box)  # -> Faces, Edges, Vertices
open_weather_file = Ladybug_OpenEPWWeatherFile(open=Toggle(True))  # -> epwFile; plug-in component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
# RC building simulation
emissionsystems = EmissionSystems()  # -> out; plug-in component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
buildingphysics = BuildingPhysics()  # -> out; plug-in component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
python = PythonScript()  # -> out
# ---------- python: Python ----------
"""
A more flexible Zone definition for the Building object in buildingPhysics.py. Objectives are to make the Building
object suitable for:
    non-rectangular floor plans
    rooms bounded by roofs in terms of transmission area and the resulting room volumes
    different windows bounding the same Zone
    different wall constructions along the same Zone
    bounding surfaces (wall and ground slab) below grade


__authors__ = "Justin Zarb"
__copyright__ = "Copyright 2017, Architecture and Building Systems - ETH Zurich"
__credits__ = ["Prageeth Jayathissa"]
__license__ = "MIT"
__version__ = "0.1"
__maintainer__ = "Justin Zarb"
__email__ = "zarbj@arch.ethz.ch"
__status__ = "under development"

"""

# Global Variables
accepted_opaque_element_names = ['wall', 'groundslab', 'slab', 'floor', 'door', 'roof', 'dach', 'wand', 'boden', 'ture',
                                 'decke']
accepted_glazing_names = ['window', 'glazed', 'glazing', 'fenster', 'skylight', 'sky light']

class Element(object):
    """
    Element object representing an opaque or transparent element.
    ##OUTLOOK##
    Subgrade: currently a dummy attribute but this would indicate that the element is in contact with the ground
    rather than the outside air.
    absorptivity, reflectivity: Not yet implemented, but adding these parameters would make it possible to include
    solar gains calculations to opaque elements. The RC model would need to be adapted for this.
    Note to future developers: when adding attributes, make sure to upadate the copy method below with the same
    attributes!
    """
    def __init__(self,
                 name = 'wall', #should contain one of the following: [Wall, Window, Ground slab, Roof]
                 area = 15.0, #Element area, [m2]
                 u_value = 1.0, #Element u_value-value, [W/m2.K]
                 subgrade = False, #Element above or below ground level. todo: modify building_physics accordingly
                 azimuth_tilt = 0, #South facing by default
                 altitude_tilt = 90, #vertical surfaces by default
                 solar_transmittance = 0.7,
                 light_transmittance=0.8,
                 shading_factor=1.0,
                 frame_factor=1.0
                 ):

        self.name = name
        self.area = area
        self.u_value = u_value
        self.subgrade = subgrade
        self.h_tr = self.u_value * self.area #element conductance [W/K]
        self.azimuth_tilt = azimuth_tilt
        self.altitude_tilt = altitude_tilt
        self.shading_factor = shading_factor
        self.frame_factor = frame_factor

        if any(x in str.lower(self.name) for x in accepted_glazing_names):
            self.solar_transmittance = solar_transmittance
            self.light_transmittance = light_transmittance
        else:
            self.solar_transmittance = 0
            self.light_transmittance = 0

    def copy(self):
        return Element(name = self.name,
                       area = self.area,
                       u_value = self.u_value,
                       subgrade = self.subgrade,
                       azimuth_tilt = self.azimuth_tilt,
                       altitude_tilt = self.altitude_tilt,
                       solar_transmittance = self.solar_transmittance,
                       light_transmittance= self.light_transmittance,
                       shading_factor= self.shading_factor)

class ThermalBridge(object):
    def __init__(self,
                 name,
                 length,
                 linear_conductance):
        self.name = name
        self.length = length
        self.linear_conductance = linear_conductance
        self.h_tr = length * linear_conductance

    def copy(self):
        return ThermalBridge(name = self.name,
                             length = self.length,
                             linear_conductance= self.linear_conductance)


class Zone(object):
    def __init__(self,
                 name = 'Default Zone', #for Calibrated Retrofit Analyisis, this should be of the form "Building#"
                 occupants = 1,
                 elements = None,
                 thermal_bridges = None,
                 floor_area = 34.3,
                 volume = 106.33,
                 thermal_capacitance_per_floor_area=165000,
                 ach_vent=1.5,
                 ach_infl=0.5,
                 ventilation_efficiency=1,
                 t_set_heating = 20,
                 t_set_cooling = 26,
                 max_heating_energy_per_floor_area = np.inf,
                 max_cooling_energy_per_floor_area = -np.inf,
                 heating_supply_system = supply_system.OilBoilerMed,
                 heating_emission_system = emission_system.OldRadiators,
                 cooling_supply_system = supply_system.HeatPumpAir,
                 cooling_emission_system = emission_system.AirConditioning
                ):

        self.name = name
        # Element objects
        self.elements = elements
        self.elements_added = 0  # for reporting purposes
        self.element_names = []  # for reporting purposes
        # Thermal bridges
        self.thermal_bridges = thermal_bridges

        # direct inputs
        self.occupants = occupants
        self.floor_area = floor_area
        self.volume = volume
        self.total_internal_area = floor_area * 4.5 #ISO13790 7.2.2.2
        self.ach_vent = ach_vent
        self.ach_infl = ach_infl
        self.ventilation_efficiency = ventilation_efficiency
        self.thermal_capacitance_per_floor_area=thermal_capacitance_per_floor_area
        self.max_heating_energy_per_floor_area = max_heating_energy_per_floor_area
        self.max_cooling_energy_per_floor_area = max_cooling_energy_per_floor_area
        self.heating_supply_system = heating_supply_system
        self.heating_emission_system = heating_emission_system
        self.cooling_supply_system = cooling_supply_system
        self.cooling_emission_system = cooling_emission_system
        self.t_set_heating = t_set_heating
        self.t_set_cooling = t_set_cooling

        # initialize envelope properties
        self.h_tr_em = 0
        self.h_tr_w = 0
        self.wall_area = 0
        self.window_area = 0
        self.window_wall_ratio = 0

        #if left blank, zone elements will be set to ASF default values
        if self.elements == None:
            Window = Element(name='ASF_window', area=13.5, u_value=1.1)
            Wall = Element(name='ASF_wall', area=1.69, u_value=0.2)
            self.elements = [Window,Wall]

        for element in self.elements:
            self.add_elements(element)

        if self.thermal_bridges is not None:
            for tb in self.thermal_bridges:
                self.add_thermal_bridge(tb)


    def add_elements(self,e):
        self.element_names.append(e.name)
        #raise error for invalid names
        if not any(x in str.lower(e.name) for x in accepted_opaque_element_names + accepted_glazing_names):
            raise NameError('element ', e.name, ' is not an accepted element name')
        # add window conductance to window conductances
        if any(x in str.lower(e.name) for x in accepted_glazing_names):
            self.h_tr_w += e.h_tr
            self.elements_added += 1
            self.window_area += e.area
        # add surface conductances to conductance of mass
        if any(x in str.lower(e.name) for x in accepted_opaque_element_names):
            self.h_tr_em += e.h_tr
            self.elements_added += 1
            self.wall_area += e.area

    def add_thermal_bridge(self,tb):
        self.h_tr_em += tb.h_tr
        self.elements_added += 1

    def summary(self):
        #report the number of elements added to facilitate bug detection
        print 'Zone with %i elements'%len(self.elements)

        print 'Conductance of opaque surfaces to exterior [W/K], h_tr_em:', self.h_tr_em
        print 'Conductance to exterior through glazed surfaces [W/K], h_tr_w', self.h_tr_w
        print 'windows: %f m2, walls: %f m2, total: %f m2'%(self.window_area,self.wall_area,self.window_area+self.wall_area)
        print 'window to wall ratio: %f %%\n' %(int(round(self.window_area/self.wall_area*100,1)))


    def copy(self):
        return Zone(name = self.name,
                    occupants = self.occupants,
                    elements = [e.copy() for e in self.elements],
                    thermal_bridges = [tb.copy() for tb in self.thermal_bridges],
                    floor_area = self.floor_area,
                    volume = self.volume,
                    thermal_capacitance_per_floor_area=self.thermal_capacitance_per_floor_area,
                    ach_vent=self.ach_vent,
                    ach_infl=self.ach_infl,
                    ventilation_efficiency=self.ventilation_efficiency,
                    t_set_heating = self.t_set_heating,
                    t_set_cooling = self.t_set_cooling,
                    max_heating_energy_per_floor_area = self.max_heating_energy_per_floor_area,
                    heating_supply_system = self.heating_supply_system,
                    heating_emission_system = self.heating_emission_system)

    def change_elements(self,newelements):
        return Zone(name = self.name,
                    occupants = self.occupants,
                    elements = newelements,
                    thermal_bridges = [tb.copy() for tb in self.thermal_bridges],
                    floor_area = self.floor_area,
                    volume = self.volume,
                    thermal_capacitance_per_floor_area=self.thermal_capacitance_per_floor_area,
                    ach_vent=self.ach_vent,
                    ach_infl=self.ach_infl,
                    ventilation_efficiency=self.ventilation_efficiency,
                    t_set_heating = self.t_set_heating,
                    t_set_cooling = self.t_set_cooling,
                    max_heating_energy_per_floor_area = self.max_heating_energy_per_floor_area,
                    heating_supply_system = self.heating_supply_system,
                    heating_emission_system = self.heating_emission_system)



if __name__ == '__main__':
    test_window = Element(name='window_S')
    print test_window.name, 'light transmittance: ', test_window.light_transmittance

    test_wall = Element(name='wall_E',azimuth_tilt=-90)
    print test_wall.name, 'light transmittance: ', test_wall.light_transmittance

    print 'testing zone:'
    test_zone = Zone()
    print 'window area: %f wall area: %s'%(test_zone.window_area, test_zone.wall_area)
    print 'h_tr_w: ',test_zone.h_tr_w
print 'h_tr_em: ',test_zone.h_tr_em
# ---------- end python ----------
supplysystems = SupplySystems()  # -> out; plug-in component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

# ---- group: display
cull_i = CullIndex(List=debrep.Faces, Indices=outward_facing_surfaces, Wrap=True)
cluster = Cluster(G=debrep.Faces, L=debrep.Faces)  # -> orientedtocam, int_2
tag = TextTag3D(Location=cluster.orientedtocam, Text=cluster.int_2, Size=0.4, Justification=7)

# ----
item = ListItem(List=debrep.Faces, Index=outward_facing_surfaces, Wrap=True)
importepw = Ladybug_ImportEpw(epwFile=open_weather_file)  # -> readMe, latitude, location, dryBulbTemperature, dewPointTemperature, relativeHumidity, windSpeed, windDirection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; plug-in component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
gencumulativeskymtx = Ladybug_GenCumulativeSkyMtx(epwFile=open_weather_file, skyDensity=0, useOldRes=True, runIt=Toggle(True))  # -> readMe, cumulativeSkyMtx; plug-in component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
window_wall_ratio = Slider(0.9, range=0..1)
edges = BrepEdges(Brep=item)  # -> simplify(Naked), Interior, NonManifold
join = JoinCurves(Curves=edges.Naked, Preserve=False)
area = Area(Geometry=join)  # -> simplify(Area), Centroid
scale = Scale(Geometry=join, Center=area.Centroid, Factor=window_wall_ratio)  # -> flatten(Geometry), Transform
area_2 = Area(Geometry=scale.Geometry)  # -> Area, Centroid
legendpar = Ladybug_LegendParameters(highBound=3000)  # -> legendPar; plug-in component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
ma = MassAddition(Input=area_2.Area)  # -> Result, PartialResults
cooling_sp = Panel("26")
start_month_2 = Panel("18")
srfsplit = SurfaceSplit(Surface=item, Curves=scale.Geometry)
total_window_area = Panel(ma.Result)
cdd_hdd = Ladybug_CDD_HDD(
    hourlyDryBulbTemperature=importepw.dryBulbTemperature,
    coolingBaseTemperature=cooling_sp,
    heatingBaseTemperature=start_month_2)  # -> readMe, daily_coolingDegDays, daily_heatingDegDays, monthly_coolingDegDays, monthly_heatingDegDays, annual_coolingDegDays, annual_heatingDegDays; plug-in component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
walls = ListItem(List=srfsplit, Index=0, Wrap=True)  # -> flatten(Item)
walls_2 = ListItem(List=srfsplit, Index=1, Wrap=True)  # -> flatten(Item)

# ---- group: External envelope area
area_3 = Area(Geometry=flatten([walls, walls_2]))  # -> Area, Centroid
ma_2 = MassAddition(Input=area_3.Area)  # -> Result, PartialResults

# ----
window_area = Area(Geometry=walls_2)  # -> Area, Centroid

# ----
# Create Zone
number_slider = Slider(1.5, range=0..1.5)
zone1 = Zone1(
    window_area=window_area.Area,
    external_envelope_area=ma_2.Result,
    room_depth="7",
    room_width=panel,
    room_height="3.1",
    ach_vent=number_slider,
    ach_infl=Slider(0.3, range=0..0.6))  # -> readMe, Zone, local_and_global_variables; plug-in component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

strnum = Ladybug_SeparateData(inputList=flatten(cdd_hdd.monthly_coolingDegDays))  # -> numbers, strings; plug-in component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
strnum_2 = Ladybug_SeparateData(inputList=flatten(cdd_hdd.monthly_heatingDegDays))  # -> numbers, strings; plug-in component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
zone2 = Zone2()  # -> readMe, Zone, local_and_global_variables; plug-in component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
cdd = Panel(strnum.numbers)
# Lighting data
title = Panel("indoor_air_temperature")
title_2 = Panel("outdoor_air_temperature")
title_3 = Panel("occupancy")
title_4 = Panel("ill")
hdd = Panel(strnum_2.numbers)
# Energy data
title_5 = Panel("HOY")
title_6 = Panel("solar_gains")
title_7 = Panel("heating_demand")
title_8 = Panel("cooling_demand")
title_9 = Panel("lighting_demand")
# Temperature data
title_10 = Panel("HOY")
title_11 = Panel("internal_gains")

# ----
# Run RC model unit tests
test = Slider(0, range=0..16)
unit_test_master = UnitTestMaster(run=test)  # -> out, number_of_tests, Office, port, outdoor_air_temperature, previous_mass_temperature, internal_gains, solar_gains, illuminance, occupancy; inputs run: Int32; plug-in component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
c_script = CSharpScript(name="test", min=0, max=unit_test_master.number_of_tests, decimals=0)  # -> out, A; inputs name: String, min: Double, max: Double, decimals: Int32
# ---------- c_script: C# ----------
    foreach (IGH_DocumentObject obj in owner.OnPingDocument().Objects )
    {
      Grasshopper.Kernel.Special.GH_NumberSlider slider = obj as Grasshopper.Kernel.Special.GH_NumberSlider;
      if (slider == null) { continue; }
      if (slider.NickName.Equals(name, StringComparison.OrdinalIgnoreCase))
      {
        double norm = slider.Slider.NormalizedValue;

        slider.Slider.Minimum = (decimal) min;
        slider.Slider.Maximum = (decimal) max;
        if (decimals <= 0)
        {
          slider.Slider.Type = Grasshopper.GUI.Base.GH_SliderAccuracy.Integer;
        }
        else
        {
          slider.Slider.Type = Grasshopper.GUI.Base.GH_SliderAccuracy.Float;
          slider.Slider.DecimalPlaces = decimals;
        }

        //Must disable events since we are modifying this thing during a solution.
        //This is actually illegal.
        slider.Slider.RaiseEvents = false;
        slider.Slider.NormalizedValue = norm;
        slider.Slider.RaiseEvents = true;
      }
    }
# ---------- c_script: C# additional code ----------
///Taken from: http://www.grasshopper3d.com/forum/topics/change-number-slider-parameter-using-python
# ---------- end c_script ----------
simulateonetimestep = SimulateASingleTimeStep(
    Zone=unit_test_master.Office,
    outdoor_air_temperature=unit_test_master.outdoor_air_temperature,
    previous_mass_temperature=unit_test_master.previous_mass_temperature,
    internal_gains=unit_test_master.internal_gains,
    solar_gains=unit_test_master.solar_gains,
    illuminance=unit_test_master.illuminance,
    occupancy=unit_test_master.occupancy)  # -> readMe, indoor_air_temperature, mass_temperature, lighting_demand, heating_demand, heating_sys_electricity, cooling_demand, cooling_sys_electricity, energy_demand, cop; plug-in component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
unit_test_slave = UnitTestSlave(
    mass_temperature=simulateonetimestep.mass_temperature,
    lighting_demand=simulateonetimestep.lighting_demand,
    heating_sys_electricity=simulateonetimestep.heating_sys_electricity,
    cooling_sys_electricity=simulateonetimestep.cooling_sys_electricity,
    energy_demand=simulateonetimestep.energy_demand,
    cop=simulateonetimestep.cop,
    run=test)  # -> out, test_passed; inputs run: Int32; plug-in component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
panel_2 = Panel(unit_test_slave.out)
c_script_2 = CSharpScript(toggle=unit_test_slave.test_passed)  # -> out, A; inputs toggle: Boolean
# ---------- c_script_2: C# ----------
    Color ok = Color.Green;
    Color notOk = Color.Red;

    List<Grasshopper.Kernel.Special.GH_Group> groups = GrasshopperDocument
      .Objects
      .OfType<Grasshopper.Kernel.Special.GH_Group>()
      .Where(gr => gr.ObjectIDs.Contains(Component.InstanceGuid))
      .ToList<Grasshopper.Kernel.Special.GH_Group>();

    Color renderColor = ok;
    if (!toggle)
    {
      renderColor = notOk;
    }

    foreach (Grasshopper.Kernel.Special.GH_Group gr in groups)
    {
      gr.Colour = renderColor;
    }
# ---------- end c_script_2 ----------

panel_3 = Panel("C:\Users\Zghiru\Documents\GitHub\RC_BuildingSimulator\rc_simulator\grasshopper_component\tests\grasshopper_result_energy.csv")  # disabled
panel_4 = Panel("C:\Users\Zghiru\Documents\GitHub\RC_BuildingSimulator\rc_simulator\grasshopper_component\tests\grasshopper_result_temperatures.csv")  # disabled
radiation = Panel("hoy")
radiation_2 = Panel("radiation")
radiation_3 = Panel("internal_gains")
panel_5 = Panel("C:\Users\Zghiru\Documents\GitHub\RC_BuildingSimulator\rc_simulator\grasshopper_component\tests\grasshopper_result_lighting.csv")  # disabled
sunpath = Ladybug_SunPath(
    location=importepw.location,
    hour=12,
    day=start_day,
    month=start_month,
    timeStep=1,
    sunPathScale=0.1,
    dailyOrAnnualSunPath=True)  # -> readMe, sunVectors, sunAltitudes, sunAzimuths, port, sunSpheresMesh, sunPathCrvs, compassCrvs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; plug-in component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
toggle = BooleanToggle(False)
panel_6 = Panel("C:\Users\Zghiru\Documents\GitHub\RC_BuildingSimulator\rc_simulator\grasshopper_component\tests\grasshopper_attributes.csv")
panel_7 = Panel("C:\Users\Zghiru\Documents\GitHub\RC_BuildingSimulator\rc_simulator\grasshopper_component\tests\grasshopper_result.csv")
python_2 = PythonScript(results=zone1.local_and_global_variables, fileAddress=panel_6, export=toggle)  # -> out, a; inputs results: list
# ---------- python_2: Python ----------
import Rhino as rc

if export:
    fileName = open(fileAddress,'w+')
    for line in results:
        fileName.write(line + '\n')
    fileName.close()
# ---------- end python_2 ----------
# y-axis ticks (in progress)
panel_8 = Panel("0")
eval = Evaluate(F="(y-x)/z+1", x=panel_8, y="30", z="5")
graph_gridlines = PythonScript(start=panel_8, end="30", y_interval="5", x_length=number_of_hours)  # -> out, a; inputs x_length: Int32
# ---------- graph_gridlines: Python ----------
"""
This funtion creates a series of lists which can be used 

list_to_tree was taken from https://gist.github.com/piac/ef91ac83cb5ee92a1294
"""
domain = end - start

def list_to_tree(input, none_and_holes=True, source=[0]):
    """Transforms nestings of lists or tuples to a Grasshopper DataTree"""
    from Grasshopper import DataTree as Tree
    from Grasshopper.Kernel.Data import GH_Path as Path
    from System import Array
    def proc(input,tree,track):
        path = Path(Array[int](track))
        if len(input) == 0 and none_and_holes: tree.EnsurePath(path); return
        for i,item in enumerate(input):
            if hasattr(item, '__iter__'): #if list or tuple
                track.append(i); proc(item,tree,track); track.pop()
            else:
                if none_and_holes: tree.Insert(item,path,i)
                elif item is not None: tree.Add(item,path)
#if input is not None: t=Tree[object]();proc(input,t,source[:]);return t

# create a list of the desired ticks
y_ticks = []
number_of_ticks = int(domain//y_interval)
for ii in range(0,number_of_ticks):
    y_ticks.append(start+ii*y_interval)

# create a list of lists, with each sublist having length x_length
tick_list = []
for tick in y_ticks:
    tick_list.append([tick]*x_length)

a = list_to_tree(tick_list,True,[0])
# ---------- end graph_gridlines ----------
series = Series(Start=panel_8, Step="5", Count=eval)
dup = DuplicateData(Data=graft(series), Number=number_of_hours, Order=True)
panel_9 = Panel(graph_gridlines.out)
number_slider_2 = Slider(19, range=-15..30)

panel_10 = Panel("C:\Users\Zghiru\Documents\GitHub\RC_BuildingSimulator\rc_simulator\grasshopper_component")  # disabled
toggle_2 = BooleanToggle(False)  # disabled
exportladybug = Ladybug_ExportLadybug(components=emissionsystems, targetFolder=panel_10, export=toggle_2)  # -> readMe; disabled; plug-in component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
panel_11 = Panel(exportladybug)  # disabled

number_slider_3 = Slider(20, range=-15..30)
number_slider_4 = Slider(0.1, range=0..1)
number_slider_5 = Slider(95, range=0..2000)
number_slider_6 = Slider(2000, range=0..2000)

# ---- group: Hacky grasshopper way to read schedule from csv
# Export Attributes and Results
occupancy_schedules_csv = Panel("C:\Users\Zghiru\Documents\GitHub\RC_BuildingSimulator\rc_simulator\grasshopper_component\occupancy_schedules.csv")
file = ReadFile(File=occupancy_schedules_csv, PerLineParse=True)
list = ValueList({"Multi Residential": 0, "Single Residential": 1, "Hotel": 2, "Office": 3, "Retail": 4, "Foodstore": 5, "Restaurant": 6, "Industrial": 7, "School": 8, "Hospital": 9, "Gym": 10}, selected="Office")
split = TextSplit(Text=file, Separators=",")  # -> simplify(Result)
item_2 = ListItem(List=split, Index=list, Wrap=True)  # -> flatten(Item)
cull_i_2 = CullIndex(List=item_2, Indices=0, Wrap=True)

# ----
panel_12 = Panel(split)
python_3 = PythonScript(X=occupancy_schedules_csv, Y=list)  # -> Out, A

# ---- group: sets time steps for simulation
hour_to_simulate = Slider(0, range=0..138)
doy_hoy = Ladybug_DOY_HOY(days=start_day, months=start_month, hours=1)  # -> HOY, DOY, date; plug-in component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
series_2 = Series(Start=0, Step=1, Count=number_of_hours)
fly = Ladybug_fly(inputSliders=hour_to_simulate, fly=run_radiation)  # -> Vviiiiiiiiiizzz; plug-in component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
c_script_3 = CSharpScript(name="hour_to_simulate", min=0, max=number_of_hours, decimals=0)  # -> out, A; inputs name: String, min: Double, max: Double, decimals: Int32; same code as c_script

# ----
addition = Addition(A=doy_hoy.HOY, B=series_2)
int = Integer(addition)

# ---- group: Hacky grasshopper way to read schedule from csv (continued)
item_3 = ListItem(List=cull_i_2, Index=int, Wrap=True)

# ---- group: sets time steps for simulation (continued)
item_4 = ListItem(List=int, Index=hour_to_simulate, Wrap=True)

# ---- group: Make sure the inputs for internal gains, occupancy and occupancy come out in the right format
multiplication = Multiplication(A=panel, B="7")
python_4 = PythonScript(area=multiplication, max_occupancy="3", occupancy_per_m2=item_3)  # -> out, occupancy, internal_gains; inputs occupancy_per_m2: list
# ---------- python_4: Python ----------
# This doesn't make sense yet 
#The units for rate should be 
# occupancy = rate * number of occupants * area

gains_per_person = 100 #W
appliance_gains = 14  # W per sqm

occupancy = list(map(lambda x:max_occupancy*x, occupancy_per_m2))

internal_gains = list(map(lambda x: gains_per_person*x + area*appliance_gains, occupancy))
# ---------- end python_4 ----------

# ---- group: simulate radiation
selectskymtx = Ladybug_selectSkyMtx(cumulativeSkyMtx=gencumulativeskymtx.cumulativeSkyMtx, HOY=item_4, removeDiffuse=False, removeDirect=False)  # -> readMe, selectedSkyMtx; plug-in component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
radiationanalysis = Ladybug_RadiationAnalysis(
    geometry=flatten(walls_2),
    gridSize="1",
    disFromBase=".1",
    selectedSkyMtx=flatten(selectskymtx.selectedSkyMtx),
    legendPar=flatten(legendpar),
    runIt=Toggle(True))  # -> readMe, contextMesh, analysisMesh, testPts, testVec, port, radiationResult, radiationMesh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; plug-in component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
multiplication_2 = Multiplication(A=radiationanalysis.totalRadiation, B=1000)
variable_recorder = PythonScript(x=multiplication_2, array_length=number_of_hours)  # -> out, recorded_result; inputs array_length: Int32
# ---------- variable_recorder: Python ----------
"""
Data recorder with variable output length.

#TODO: reset recL every time array_length is changed.
"""
if 'recL' in locals() and array_length!=None:
        recL.append(x)
else:
    recL = []

recorded_result = recL[len(recL)-array_length:]
# ---------- end variable_recorder ----------

# ---- group: Temperatures
strnum_3 = Ladybug_SeparateData(inputList=flatten(importepw.dryBulbTemperature))  # -> numbers, strings; plug-in component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
item_5 = ListItem(List=strnum_3.numbers, Index=int, Wrap=True)  # -> simplify(Item)

# ----
pt = Point(radiationanalysis.testPts)
panel_13 = Panel(variable_recorder.recorded_result)
ins = InsertItems(List=int, Item=title_5, Indices=0, Wrap=True)  # -> graft(List)
ins_2 = InsertItems(List=python_4.internal_gains, Item=title_11, Indices=0, Wrap=True)  # -> graft(List)
ins_3 = InsertItems(List=int, Item=title_10, Indices=0, Wrap=True)  # -> graft(List)
ins_4 = InsertItems(List=item_5, Item=title_2, Indices=0, Wrap=True)  # -> graft(List)
ins_5 = InsertItems(List=int, Item=title_10, Indices=0, Wrap=True)  # -> graft(List)
ins_6 = InsertItems(List=python_4.occupancy, Item=title_3, Indices=0, Wrap=True)  # -> graft(List)

# ---- group: simulate period
# Simulate Period
simulatemultipletimesteps = SimulateMultipleTimeSteps(
    Zone=zone1.Zone,
    outdoor_air_temperature=item_5,
    internal_gains=python_4.internal_gains,
    solar_irradiation=variable_recorder.recorded_result,
    occupancy=python_4.occupancy)  # -> out, indoor_air_temperature, mass_temperature, lighting_demand, heating_demand, cooling_demand, energy_demand, solar_gains, ill; inputs outdoor_air_temperature: list, previous_mass_temperature: list, internal_gains: list, solar_irradiation: list, occupancy: list; plug-in component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
outdoor_temperature = Panel(item_5)
cooling_demand_w = Panel(simulatemultipletimesteps.cooling_demand)
heating_demand_w = Panel(simulatemultipletimesteps.heating_demand)
indoor_temperature = Panel(simulatemultipletimesteps.indoor_air_temperature)
lighting_demand_w = Panel(simulatemultipletimesteps.lighting_demand)
mass_temperature = Panel(simulatemultipletimesteps.mass_temperature)

# ----
ins_7 = InsertItems(List=simulatemultipletimesteps.cooling_demand, Item=title_8, Indices=0, Wrap=True)  # -> graft(List)
ins_8 = InsertItems(List=simulatemultipletimesteps.heating_demand, Item=title_7, Indices=0, Wrap=True)  # -> graft(List)
ins_9 = InsertItems(List=simulatemultipletimesteps.lighting_demand, Item=title_9, Indices=0, Wrap=True)  # -> graft(List)
ins_10 = InsertItems(List=simulatemultipletimesteps.solar_gains, Item=title_6, Indices=0, Wrap=True)  # -> graft(List)
ins_11 = InsertItems(List=simulatemultipletimesteps.indoor_air_temperature, Item=title, Indices=0, Wrap=True)  # -> graft(List)
ins_12 = InsertItems(List=simulatemultipletimesteps.ill, Item=title_4, Indices=0, Wrap=True)  # -> graft(List)
merge = Merge(
    Data1=simplify(ins),
    Data2=simplify(ins_10),
    Data3=simplify(ins_8),
    Data4=simplify(ins_7),
    Data5=simplify(ins_9),
    Data6=simplify(ins_2))  # disabled
merge_2 = Merge(Data1=simplify(ins_3), Data2=simplify(ins_4), Data3=simplify(ins_11))  # disabled
merge_3 = Merge(Data1=simplify(ins_5), Data2=simplify(ins_12), Data3=simplify(ins_6))  # disabled
day_month_hour_calculator = Ladybug_Day_Month_Hour(HOY=int)  # -> day, month, hour, date; plug-in component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
panel_14 = Panel(simulatemultipletimesteps.out)
join_2 = TextJoin(Text=merge, Join=",")  # -> flatten(Result); disabled
join_3 = TextJoin(Text=merge_2, Join=",")  # -> flatten(Result); disabled
join_4 = TextJoin(Text=merge_3, Join=",")  # -> flatten(Result); disabled
ins_13 = InsertItems(List=variable_recorder.recorded_result, Item=radiation_2, Indices=0, Wrap=True)  # -> graft(List)
ins_14 = InsertItems(List=python_4.internal_gains, Item=radiation_3, Indices=0, Wrap=True)  # -> graft(List)
ins_15 = InsertItems(List=day_month_hour_calculator.date, Item=radiation, Indices=0, Wrap=True)  # -> graft(List)
python_5 = PythonScript(results=join_2, fileAddress=panel_3, export=toggle)  # -> out, a; inputs results: list; disabled
# ---------- python_5: Python ----------
import Rhino as rc

if export:
    fileName = open(fileAddress,'w')
    for line in results:
        fileName.write(line + '\n')
    fileName.close()
# ---------- end python_5 ----------
python_6 = PythonScript(results=join_3, fileAddress=panel_4, export=toggle)  # -> out, a; inputs results: list; disabled; same code as python_5
python_7 = PythonScript(results=join_4, fileAddress=panel_5, export=toggle)  # -> out, a; inputs results: list; disabled; same code as python_5
merge_4 = Merge(Data1=simplify(ins_15), Data2=simplify(ins_13), Data3=simplify(ins_14))
join_5 = TextJoin(Text=merge_4, Join=",")  # -> flatten(Result)
merge_5 = Merge(
    Data1=simplify(ins),
    Data2=simplify(ins_10),
    Data3=simplify(ins_8),
    Data4=simplify(ins_7),
    Data5=simplify(ins_9),
    Data6=simplify(ins_2),
    Data7=simplify(ins_3),
    Data8=simplify(ins_4),
    Data9=simplify(ins_11),
    Data10=simplify(ins_5),
    Data11=simplify(ins_12),
    Data12=simplify(ins_6))
inputs = Panel(join_5)

# ---- group: DNI
strnum_4 = Ladybug_SeparateData(inputList=flatten(importepw.directNormalRadiation))  # -> numbers, strings; plug-in component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
item_6 = ListItem(List=strnum_4.numbers, Index=int, Wrap=True)  # -> simplify(Item)

# ----
join_6 = TextJoin(Text=merge_5, Join=",")  # -> flatten(Result)
python_8 = PythonScript(results=join_6, fileAddress=panel_7, export=toggle)  # -> out, a; inputs results: list; same code as python_2
energy = QuickGraph(item_6)
energy_2 = QuickGraph([simulatemultipletimesteps.solar_gains, python_4.internal_gains, lighting_demand_w, heating_demand_w, cooling_demand_w])
occupancy = QuickGraph(python_4.occupancy)

# ---- group: Temperature
graph = QuickGraph([outdoor_temperature, indoor_temperature, mass_temperature, dup])

# ==== cluster Cluster
L = ClusterInput()
lng = ListLength(List=L)
G = ClusterInput()
series = Series(Start=0, Step=1, Count=lng)
area = Area(Geometry=G)  # -> Area, Centroid
int = Integer(series)
orient2camera = Ladybug_OrientToCamera(initPosition=area.Centroid)  # -> orientedToCam; plug-in component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
int_2 = ClusterOutput(int)
timer = Timer(TimerInterval=1000, Target=orient2camera)
orientedtocam = ClusterOutput(orient2camera)
